# Grasshopper definition Pattern generate.gh (Grasshopper 1.0.7)

P = Plane(PlaneXY(0, 0, 0))

number_slider = Slider(40, range=0..100)
box = CenterBox(Base=PlaneXY(0, 0, 0), X=number_slider, Y=number_slider, Z=1)
cir = Circle(Plane=P, Radius=Slider(40, range=0..100))

pt = Point(Point(0, 0, 0))
pt_2 = ConstructPoint(XCoordinate=Slider(34, range=0..40), YCoordinate=0, ZCoordinate=0)
arrpolar = PolarArray(Geometry=pt_2, Plane=PlaneXY(0, 0, 0), Count=Slider(7, range=6..18), Angle=6.283185307)  # -> Geometry, Transform
ln = Line(StartPoint=pt, EndPoint=arrpolar.Geometry)
P_2 = Plane(PlaneXY(0, 0, 0))
pi = Pi(Factor=Slider(1, range=0..1))
maelstrom = Maelstrom(Geometry=ln, Plane=P_2, First=Slider(40, range=0..40), Second=Slider(7.5, range=0..40), Angle=pi, Rigid=False)
panel = Panel(maelstrom)
number_slider_2 = Slider(10, range=0..10)
shift = ShiftList(List=maelstrom, Shift=1, Wrap=True)
number_slider_3 = Slider(0, range=0..20)
divide = DivideCurve(Curve=shift, Count=number_slider_2, Kinks=False)  # -> Points, Tangents, Parameters
divide_2 = DivideCurve(Curve=maelstrom, Count=number_slider_2, Kinks=False)  # -> Points, Tangents, Parameters
panel_2 = Panel(divide_2.Points)
multiplication = Multiplication(A=divide_2.Tangents, B=number_slider_3)
multiplication_2 = Multiplication(A=divide.Tangents, B=number_slider_3)
bzspan = BezierSpan(StartPoint=divide_2.Points, StartTangent=multiplication, EndPoint=divide.Points, EndTangent=multiplication_2)  # -> Curve, Length, Domain
panel_3 = Panel(bzspan.Curve)
panel_4 = Panel(bzspan.Length)
flatten = FlattenTree(Tree=bzspan.Curve, Path="{0}")
end = EndPoints(Curve=bzspan.Curve)  # -> Start, End
end_2 = EndPoints(Curve=bzspan.Curve)  # -> Start, End

simplify = SimplifyTree(Tree=end.Start, Front=False)

panel_5 = Panel(simplify)

# ---- group: IterA
pline = PolyLine(Vertices=end.Start, Closed=False)

# ----
panel_6 = Panel(pline)

# ---- group: ROUGH dots
flatten_2 = FlattenTree(Tree=pline, Path="{0}")

# ----
flatten_3 = FlattenTree(Path="{0}")

flip = FlipMatrix(Data=end_2.Start)
simplify_2 = SimplifyTree(Tree=flip, Front=False)
pline_2 = PolyLine(Vertices=simplify_2, Closed="true")  # -> flatten(Polyline)
cull_i = CullIndex(List=pline_2, Indices=Slider(0, range=0..100), Wrap=True)
item = ListItem(List=cull_i, Index=Slider(20, range=0..77), Wrap=True)

dots = DotDisplay(Point=simplify_2, Colour=ColourSwatch(SwatchColor=RGB(74, 134, 255)), Size=Slider(0.6, range=0..1))

# ---- group: ROUGH dots
flatten_4 = FlattenTree(Tree=simplify_2, Path="{0}")

# ----
panel_7 = Panel(simplify_2)
item_2 = ListItem(List=flatten_4, Index=Slider(11, range=0..77), Wrap=True)
panel_8 = Panel(cull_i)

# ---- group: Distance between each dispense
distance_between_each_drop = DivideDistance(Curve=cull_i, Distance=Slider(3, range=0..10))  # -> Points, Tangents, Parameters

# ----
# This data structure is important
#  to deal with changing color well
panel_9 = Panel(distance_between_each_drop.Points)

dots_2 = DotDisplay(
    Point=distance_between_each_drop.Points,
    Colour=ColourSwatch(SwatchColor=RGB(240, 139, 72)),
    Size=Slider(0.4, range=0..1))

# ---- group: FINE dots
flatten_5 = FlattenTree(Tree=distance_between_each_drop.Points, Path="{0}")

# ----
panel_10 = Panel(distance_between_each_drop.Points)
item_3 = ListItem(List=flatten_5, Index=Slider(36, range=0..77), Wrap=True)

# ---- group: Export coordinates to csv
pdecon = Deconstruct(Point=flatten_5)  # -> XComponent, YComponent, ZComponent
concat = Concatenate(FragmentA=pdecon.XComponent, FragmentB=",", FragmentC=pdecon.YComponent)
panel_11 = Panel(concat)
